# Grasshopper definition bracciale.gh (Grasshopper 0.9.76)

Y = Slider(12.466, range=-100..100)  # disabled
X = Slider(-28.32, range=-100..100)  # disabled
Y_2 = Slider(-18.338, range=-100..100)  # disabled
X_2 = Slider(-24.332, range=-100..100)  # disabled
pt = ConstructPoint(XCoordinate=X, YCoordinate=Y, ZCoordinate=0)  # disabled
pt_2 = ConstructPoint(XCoordinate=X_2, YCoordinate=Y_2, ZCoordinate=0)  # disabled
number_slider = Slider(29, range=0..30)  # disabled
box = CenterBox(Base=PlaneXY(0, 0, 0), X=pt, Y=pt_2, Z=number_slider)  # disabled
number_slider_2 = Slider(27, range=0..100)  # disabled
pt_3 = Point([<point referenced from the Rhino model> x39])  # disabled
box_2 = CenterBox(Base=PlaneXY(0, 0, 0), X=Slider(20, range=0..100), Y=Slider(20, range=0..100), Z=Slider(0, range=0..100))
geo = Geometry(simplify(<brep referenced from the Rhino model>))  # disabled
pop3d = Populate3D(Region=box, Count=Slider(20, range=0..100), Seed=1)  # disabled
pop2d = Populate2D(Region=box, Count=number_slider_2, Seed=1)  # disabled
pop2d_2 = Populate2D(Region=box_2, Count=Slider(35, range=0..100), Seed=1)
edges = BrepEdges(Brep=box_2)  # -> Naked, Interior, NonManifold
voronoi³ = Voronoi3D(Points=pop3d, Box=box)  # -> Cells, Boundary; disabled
bbx = BrepBrep(BrepA=geo, BrepB=voronoi³.Cells)  # -> Curves, Points; disabled
voronoi = Voronoi(Points=pop2d, Boundary=box, BruteForceOverride=False)  # disabled
panel = Panel(voronoi)  # disabled
voronoi_2 = Voronoi(Points=pop2d_2, Boundary=box_2, BruteForceOverride=False)
boundary = BoundarySurfaces(Edges=edges.Naked)
area = Area(Geometry=voronoi_2)  # -> Area, Centroid
pt_4 = ConstructPoint(XCoordinate=0, YCoordinate=0, ZCoordinate=0)
dist = Distance(PointA=pt_4, PointB=area.Centroid)
bnd = Bounds(Numbers=dist)
panel_2 = Panel(bnd)
dom = ConstructDomain(DomainStart=Slider(10, range=0..100), DomainEnd=Slider(18.25, range=0..24))
inc = Includes(Value=dist, Domain=dom)  # -> Includes, Deviation
neg = Negative(Value=Slider(0.72, range=0..1))
dispatch = Dispatch(List=voronoi_2, DispatchPattern=inc.Includes)  # -> ListA, ListB
cull = CullPattern(List=voronoi_2, CullPattern=inc.Includes)
offset = Offset(Curve=dispatch.ListA, Distance=neg, Plane=PlaneXY(0, 0, 0), Corners=1)
neg_2 = Negative(Value=Slider(0.72, range=0..1))
Z = UnitZ(Factor=Slider(10, range=0..10))
Z_2 = UnitZ(Factor=Slider(10, range=0..10))
brep = Brep(dispatch.ListB)
offset_2 = Offset(Curve=dispatch.ListB, Distance=neg_2, Plane=PlaneXY(0, 0, 0), Corners=1)
extr = Extrude(Base=offset, Direction=Z)
extr_2 = Extrude(Base=boundary, Direction=Z_2)  # -> flatten(Extrusion)
cap = CapHoles(Brep=extr)
Z_3 = UnitZ(Factor=Slider(10, range=0..10))
sdiff = SolidDifference(BrepsA=flatten(extr_2), BrepsB=flatten(cap))
extr_3 = Extrude(Base=brep, Direction=Z_3)
cap_2 = CapHoles(Brep=extr_3)
sdiff_2 = SolidDifference(BrepsA=flatten(sdiff), BrepsB=flatten(cap_2))
